# Grasshopper definition hello-spiral-breakdown.gh (Grasshopper 1.0.6)

xy = XYPlane(Origin=Point(0, 0, 0))
pln = Plane(xy)

# ----
# Line line = new Line(plane.Origin, plane.Origin + plane.ZAxis * height);
height = Slider(10, range=0..20)
deplane = DeconstructPlane(Plane=pln)  # -> Origin, XAxis, YAxis, ZAxis
multiplication = Multiplication(A=deplane.ZAxis, B=height)
move = Move(Geometry=deplane.Origin, Motion=multiplication)  # -> Geometry, Transform
ln = Line(StartPoint=deplane.Origin, EndPoint=move.Geometry)

# ----
# i / Convert.ToDouble(pts.Length - 1) * Pi * waves
wave = Slider(3, range=0..10)
pi = Pi(Factor=1)
panel = Panel("0.5 * (r1-r0)")
division_per_turn = Slider(20, range=0..100)

r0 = Slider(1.96, range=0..10)
r1 = Slider(4.27, range=0..10)

turns = Slider(10, range=0..10)
multiplication_2 = Multiplication(A=turns, B=division_per_turn)

# ----
# Point3d[] pts;
# line.ToNurbsCurve().DivideByCount(turns * 20, true, out pts);
divide = DivideCurve(Curve=ln, Count=multiplication_2, Kinks=False)  # -> Points, Tangents, Parameters

subtraction = Subtraction(A=r1, B=r0)
panel_2 = Panel("1 +  Math.Cos")
multiplication_3 = Multiplication(A=subtraction, B=Slider(0.5, range=0..1))

# ----
# i / Convert.ToDouble(pts.Length - 1)
lng = ListLength(List=divide.Points)
x_2 = X2(X=lng, Expression="x-1")
series = Series(Start=0, Step=1, Count=lng)
division = Division(A=series, B=x_2)

i_convert_todouble_pts_length_1 = Panel(division)
multiplication_4 = Multiplication(A=i_convert_todouble_pts_length_1, B=pi)
multiplication_5 = Multiplication(A=multiplication_4, B=wave)

cos = Cosine(Value=multiplication_5)
addition = Addition(A="1", B=cos)

pi_2 = Pi(Factor="2")
panel_3 = Panel(pi_2)

multiplication_6 = Multiplication(A=multiplication_3, B=addition)
addition_2 = Addition(A=r0, B=multiplication_6)
multiplication_7 = Multiplication(A=division, B=panel_3, C=turns)
multiplication_8 = Multiplication(A=deplane.XAxis, B=addition_2)

move_2 = Move(Geometry=divide.Points, Motion=multiplication_8)  # -> Geometry, Transform
rotate = Rotate(Geometry=move_2.Geometry, Angle=multiplication_7, Plane=pln)  # -> Geometry, Transform
intcrv = Interpolate(Vertices=rotate.Geometry, Degree=3, Periodic=False, KnotStyle=1)  # -> Curve, Length, Domain
