# Grasshopper definition voronoi.ghx (Grasshopper 1.0.7)

# ---- group: RH_IN:Count
int = Integer(Slider(80, range=0..100))

# ---- group: RH_IN:Size
num = Number(Slider(68.6, range=10..100))

# ---- group: RH_IN:Outer
num_2 = Number(Slider(36.4, range=0..100))

# ---- group: RH_IN:Inner
num_3 = Number(Slider(27.2, range=0..100))

# ----
division = Division(A=num, B=2)
pt = ConstructPoint(XCoordinate=0, YCoordinate=0, ZCoordinate=0)
neg = Negative(Value=division)
dom = ConstructDomain(DomainStart=neg, DomainEnd=division)
rectangle = Rectangle(Plane=pt, XSize=dom, YSize=dom, Radius=0)  # -> Rectangle, Length
pop2d = Populate2D(Region=rectangle.Rectangle, Count=int, Seed=1)
crv_cp = CurveClosestPoint(Point=pop2d, Curve=rectangle.Rectangle)  # -> Point, Parameter, Distance
voronoi = Voronoi(Points=pop2d, Boundary=rectangle.Rectangle, BruteForceOverride=False)
bnd = Bounds(Numbers=flatten(crv_cp.Distance))
dom_2 = ConstructDomain(DomainStart=num_2, DomainEnd=num_3)
boundary = BoundarySurfaces(Edges=voronoi)
remap = RemapNumbers(Value=crv_cp.Distance, Source=bnd, Target=dom_2)  # -> Mapped, Clipped
Z = UnitZ(Factor=remap.Mapped)
move = Move(Geometry=boundary, Motion=Z)  # -> Geometry, Transform
merge = Merge(Data2=move.Geometry)

# ---- group: RH_OUT:Geo
geo = Geometry(merge)

# ----
preview = CustomPreview(
    Geometry=geo,
    Material={diffuse=RGB(221, 160, 221), emission=RGB(66, 48, 66), shine=0.5, specular=RGB(255, 255, 255), transparency=0})
