# Grasshopper definition stickyball.gh (Grasshopper 1.0.7)

arc_radius = Slider(1, range=0..1)
z_pos = Slider(0.256, range=0..1)
x_pos = Slider(1, range=0..1)
radius_1 = Slider(1, range=0..1)
radius_2 = Slider(1, range=0..1)

# ---- group: RH_IN:ArcRadius
num = Number(arc_radius)

# ---- group: RH_IN:Radius2
num_2 = Number(radius_2)

# ---- group: RH_IN:Radius1
num_3 = Number(radius_1)

# ----
pt = ConstructPoint(XCoordinate=x_pos, YCoordinate=0, ZCoordinate=z_pos)
pt_2 = ConstructPoint(XCoordinate=0, YCoordinate=0, ZCoordinate=0)

# ---- group: RH_IN:Point2
pt_3 = Point(pt)

# ---- group: RH_IN:Point1
pt_4 = Point(pt_2)

# ----
multiplication = Multiplication(A=pt_3, B=Slider(3, range=0..10))
ln = Line(StartPoint=pt_4, EndPoint=multiplication)
vec = Vector(ln)
pl = PlaneNormal(Origin=pt_4, ZAxis=vec)
deplane = DeconstructPlane(Plane=pl)  # -> Origin, XAxis, YAxis, ZAxis
sph = Sphere(Base=pt_4, Radius=num_3)
sph_2 = Sphere(Base=multiplication, Radius=num_2)
pl_2 = ConstructPlane(Origin=deplane.Origin, XAxis=deplane.XAxis, YAxis=deplane.ZAxis)
sec = BrepPlane(Brep=sph, Plane=pl_2)  # -> Curves, Points
sec_2 = BrepPlane(Brep=sph_2, Plane=pl_2)  # -> Curves, Points
circle = Circle(sec.Curves)
circle_2 = Circle(sec_2.Curves)
tarc = TangentArcs(CircleA=circle, CircleB=circle_2, Radius=num)  # -> ArcA, ArcB
ccx = CurveCurve(CurveA=tarc.ArcA, CurveB=tarc.ArcB)  # -> Points, ParamsA, ParamsB
lng = ListLength(List=ccx.Points)
larger = LargerThan(FirstNumber=lng, SecondNumber=0)  # -> LargerThan, OrEqualTo
dispatch = Dispatch(List=tarc.ArcA, DispatchPattern=larger.LargerThan)  # -> ListA, ListB
revsrf = Revolution(Curve=dispatch.ListB, Axis=ln, Domain=Domain(0, 6.283185307))
number_slider = Slider(0.1, range=0.1..10)
merge = Merge(Data1=sph, Data2=sph_2, Data3=revsrf)  # -> flatten(Result)
join = BrepJoin(Breps=merge)  # -> Breps, Closed
custom_mesh_settings = SettingsCustom(
    StitchSeams=True,
    SimplePlanes=False,
    Refine=True,
    MinCount=16,
    MaxCount=400,
    AspectRatio=20,
    MaxDistance=0,
    MaxAngle=20,
    MinEdge=number_slider,
    MaxEdge=number_slider)
flatten = FlattenTree(Tree=join.Breps, Path="{0}")
mesh = MeshBrep(Brep=flatten, Settings=custom_mesh_settings)
Z = UnitZ(Factor=1)
mjoin = MeshJoin(Meshes=mesh)
demesh = DeconstructMesh(Mesh=mjoin)  # -> Vertices, Faces, Colours, Normals
neg = Negative(Value=Z)
dprod = DotProduct(VectorA=demesh.Normals, VectorB=neg, Unitize=False)
bnd = Bounds(Numbers=dprod)
remap = RemapNumbers(Value=dprod, Source=bnd, Target=Domain(0, 1))  # -> Mapped, Clipped
gradient = Gradient(LowerLimit=0, UpperLimit=1, Parameter=remap.Mapped, stops=[0.15: RGB(255, 130, 160), 0.85: RGB(220, 0, 40)])
mcol = MeshColours(Mesh=mjoin, Colours=gradient)
scale = Scale(Geometry=mcol, Center=Point(0, 0, 0), Factor=Slider(300, range=0..300))  # -> Geometry, Transform

# ---- group: RH_OUT:Geo
geo = Geometry(scale.Geometry)

# ----
preview = CustomPreview(
    Geometry=geo,
    Material={diffuse=RGB(221, 160, 221), emission=RGB(66, 48, 66), shine=0.5, specular=RGB(255, 255, 255), transparency=0})
