# Grasshopper definition tiling.ghx (Grasshopper 1.0.7)

number_slider = Slider(10, range=0..100)
md_slider = MDSlider(
    SliderMode=0,
    slider_value=Point(0.581366587, 0.5260748094, 0.5),
    x_domain=Domain(0, 1),
    y_domain=Domain(0, 1),
    z_domain=Domain(0, 1))

hexgrid = Hexagonal(Plane=PlaneXY(0, 0, 0), Size=Slider(1, range=0..10), ExtentX=number_slider, ExtentY=number_slider)  # -> Cells, Points
bbox = BoundingBox(Content=flatten(hexgrid.Cells), Plane=PlaneXY(0, 0, 0), UnionBox=True)  # -> Box, Box_2
flatten = FlattenTree(Tree=hexgrid.Cells, Path="{0}")
flatten_2 = FlattenTree(Tree=hexgrid.Points, Path="{0}")

# ---- group: RH_IN:Point
pt = Point(md_slider)

# ----
evalsrf = EvaluateSurface(Surface=reparameterize(bbox.Box), Point=pt)  # -> Point, Normal, UDirection, VDirection, Frame

# ---- group: RH_IN:Scale1
num = Number(Slider(0.4, range=0.1..0.9))

# ---- group: RH_IN:Scale2
num_2 = Number(Slider(0.43, range=0.1..0.9))

# ----
pt_2 = Point(evalsrf.Point)
dist = Distance(PointA=pt_2, PointB=flatten_2)
dom = ConstructDomain(DomainStart=num, DomainEnd=num_2)

# ---- group: RH_IN:Angle
int = Integer(Slider(90, range=0..90))

# ---- group: RH_IN:Height
num_3 = Number(Slider(0.7, range=0..2))

# ----
bnd = Bounds(Numbers=dist)
multiplication = Multiplication(A=num_3, B=5)
rad = Radians(Degrees=int)
remap = RemapNumbers(Value=dist, Source=bnd, Target=dom)  # -> Mapped, Clipped
remap_2 = RemapNumbers(Value=dist, Source=bnd, Target=multiplication)  # -> Mapped, Clipped
remap_3 = RemapNumbers(Value=dist, Source=bnd, Target=rad)  # -> Mapped, Clipped
scale = Scale(Geometry=flatten, Center=flatten_2, Factor=remap.Mapped)  # -> Geometry, Transform
Z = UnitZ(Factor=remap_2.Mapped)
number_slider_2 = Slider(100, range=0..100)
move = Move(Geometry=scale.Geometry, Motion=Z)  # -> Geometry, Transform
rotate = Rotate(Geometry=move.Geometry, Angle=remap_3.Mapped, Plane=flatten_2)  # -> Geometry, Transform
graft = GraftTree(Tree=flatten, IncludeEmptyLists=True, IncludeNullItems=True)  # -> simplify(Tree)
graft_2 = GraftTree(Tree=rotate.Geometry, IncludeEmptyLists=True, IncludeNullItems=True)  # -> simplify(Tree)
custom_mesh_settings = SettingsCustom(
    StitchSeams=True,
    SimplePlanes=False,
    Refine=True,
    MinCount=Slider(1, range=0..1),
    MaxCount=400,
    AspectRatio=20,
    MaxDistance=0,
    MaxAngle=20,
    MinEdge=number_slider_2,
    MaxEdge=number_slider_2)
merge = Merge(Data1=graft, Data2=graft_2)
boundary = BoundarySurfaces(Edges=rotate.Geometry)
loft = Loft(Curves=merge, Options={Adjust=False, Closed=False, LoftEnds=0, LoftSimp=0, LoftType=3, Rebuild=10, Refit=0.01})  # -> simplify(Loft)
mesh = MeshBrep(Brep=boundary, Settings=custom_mesh_settings)
smesh = SimpleMesh(Brep=loft)
merge_2 = Merge(Data1=smesh, Data2=mesh)
flatten_3 = FlattenTree(Tree=merge_2, Path="{0}")
mjoin = MeshJoin(Meshes=flatten_3)
tri = Triangulate(Mesh=mjoin)  # -> Mesh, Count
scale_2 = Scale(Geometry=tri.Mesh, Center=Point(0, 0, 0), Factor=Slider(100, range=0..100))  # -> Geometry, Transform
c_script = CSharpScript(x=scale_2.Geometry)  # -> out, A; inputs x: Mesh
# ---------- c_script: C# ----------
    x.RebuildNormals();
    
    A = x;
# ---------- end c_script ----------

# ---- group: RH_OUT:Geo
geo = Geometry(c_script.A)

# ----
preview = CustomPreview(Geometry=geo, Material=ColourSwatch(SwatchColor=RGB(38, 186, 255)))
