# Grasshopper definition Autogeneration.gh (Grasshopper 1.0.7)

c_script = CSharpScript(
    update=Toggle(False),
    seed=Slider(59507149, range=0..100000000),
    save=Button(),
    Reference=["C:\Program Files\Rhino 6\Plug-ins\Grasshopper\Components\CurveComponents.gha", "C:\Program Files\Rhino 6\Plug-ins\Grasshopper\Components\FieldComponents.gha", "C:\Program Files\Rhino 6\Plug-ins\Grasshopper\Components\GalapagosComponents.gha", "C:\Program Files\Rhino 6\Plug-ins\Grasshopper\Components\GhPython.gha", "C:\Program Files\Rhino 6\Plug-ins\Grasshopper\Components\IOComponents.gha", "C:\Program Files\Rhino 6\Plug-ins\Grasshopper\Components\Kangaroo2Component.gha", "C:\Program Files\Rhino 6\Plug-ins\Grasshopper\Components\MathComponents.gha", "C:\Program Files\Rhino 6\Plug-ins\Grasshopper\Components\ScriptComponents.gha", "C:\Program Files\Rhino 6\Plug-ins\Grasshopper\Components\SurfaceComponents.gha", "C:\Program Files\Rhino 6\Plug-ins\Grasshopper\Components\TriangulationComponents.gha", "C:\Program Files\Rhino 6\Plug-ins\Grasshopper\Components\VectorComponents.gha", "C:\Program Files\Rhino 6\Plug-ins\Grasshopper\Components\XformComponents.gha"])  # -> out, A; inputs update: Boolean, seed: Int32, save: Boolean
# ---------- c_script: C# ----------
    RemoveAllComponents(GrasshopperDocument);

    if(update){
      var rand = new Random(seed);

      var slider = new Grasshopper.Kernel.Special.GH_NumberSlider();
      slider.CreateAttributes();
      slider.Attributes.Pivot = new System.Drawing.PointF(100, 100);
      slider.Slider.Minimum = new Decimal(0.0);
      slider.Slider.Maximum = new Decimal(100.0);
      slider.SetSliderValue(new Decimal(rand.NextDouble() * 100.0));
      components.Add(slider);
      GrasshopperDocument.AddObject(slider, false);

      var polygon = new CurveComponents.Component_Polygon();
      polygon.CreateAttributes();
      polygon.Attributes.Pivot = new System.Drawing.PointF(400, 100);
      polygon.Params.Input[1].AddSource(slider);
      var segInput = polygon.Params.Input[2] as Grasshopper.Kernel.GH_PersistentParam<Grasshopper.Kernel.Types.GH_Integer>;
      segInput.PersistentData.ClearData();
      segInput.PersistentData.Append(new GH_Integer(rand.Next(3, 10)));
      components.Add(polygon);
      GrasshopperDocument.AddObject(polygon, false);

      if(rand.NextDouble() < 0.5){
        var boundary = new SurfaceComponents.SurfaceComponents.Component_BoundarySurfaces();
        boundary.CreateAttributes();
        boundary.Attributes.Pivot = new System.Drawing.PointF(550, 100);
        boundary.Params.Input[0].AddSource(polygon.Params.Output[0]);
        components.Add(boundary);
        GrasshopperDocument.AddObject(boundary, false);
      }

      var geom = new Grasshopper.Kernel.Parameters.Param_Geometry();
      geom.CreateAttributes();
      geom.Attributes.Pivot = new System.Drawing.PointF(700, 100);
      geom.AddSource(((GH_Component) components[components.Count - 1]).Params.Output[0]);
      components.Add(geom);
      GrasshopperDocument.AddObject(geom, false);
      
      geom.CollectData();
      A = geom.VolatileData.AllData(true);

      if(save){
        GrasshopperDocument.ScheduleSolution(0, (val) => {
          var savedoc = new GH_Document();
          foreach(var component in components){
            savedoc.AddObject(component, false);
          }
          var docIO = new GH_DocumentIO(savedoc);
          docIO.SaveAs();
          });
      }
    }
# ---------- c_script: C# additional code ----------
  public List<GH_ActiveObject> components = new List<GH_ActiveObject>();
  public List<GH_ActiveObject> reserveComponents = new List<GH_ActiveObject>();

  public void RemoveAllComponents(GH_Document doc){
    reserveComponents.Clear();
    foreach(var component in components){
      reserveComponents.Add(component);
    }
    doc.ScheduleSolution(0, (val) => {
      foreach(var component in reserveComponents){
        doc.RemoveObject(component.Attributes, false);
        components.Remove(component);
      }
      reserveComponents.Clear();
      });
  }
# ---------- end c_script ----------
geo = Geometry(c_script.A)
