# Grasshopper definition matcap_shader.gh (Grasshopper 1.0.7)
# plug-ins: ghgl

polygon = Polygon(Plane=PlaneXY(0, 0, 0), Radius=Slider(100, range=0..100), Segments=Slider(10, range=0..10), FilletRadius=0)  # -> Polygon, Length
range = Range(Domain=Domain(0, 1), Steps=10)
pi = Pi(Factor=Slider(0.7, range=0..10))
multiplication = Multiplication(A=range, B=Slider(304.3, range=0..1000))
multiplication_2 = Multiplication(A=range, B=pi)
Z = UnitZ(Factor=multiplication)
graph = GraphMapper(
    range,
    x0=0,
    x1=1,
    y0=0,
    y1=1,
    container_name="Sine",
    Equation_px=[0.3372268677, 0.9288110137],
    Equation_py=[0.9530826807, 0.2103429437])
move = Move(Geometry=polygon.Polygon, Motion=Z)  # -> Geometry, Transform
rotate = Rotate(Geometry=move.Geometry, Angle=multiplication_2, Plane=PlaneXY(0, 0, 0))  # -> Geometry, Transform
scale_nu = ScaleNU(Geometry=rotate.Geometry, Plane=PlaneXY(0, 0, 0), ScaleX=graph, ScaleY=graph, ScaleZ=1)  # -> Geometry, Transform
loft = Loft(
    Curves=scale_nu.Geometry,
    Options={Adjust=False, Closed=False, LoftEnds=0, LoftSimp=0, LoftType=0, Rebuild=10, Refit=0.01})
sph = Sphere(Base=PlaneXY(0, 0, 0), Radius=Slider(100, range=0..100))
mesh = MeshBrep(
    Brep=loft,
    Settings={GridMaxCount=0, GridMinCount=16, JaggedSeams=False, MaxEdgeLength=0, MinEdgeLength=0.0001, MinTolerance=0, Refine=True, RefineAngle=0, RelativeTolerance=0.65, SimplePlanes=True, Tolerance=0})
path = FilePath("C:\Users\jhorikawa\Desktop\images\163-free-matcaps-blue-ball-png-clipart.jpg")
gl_mesh = GLMeshShader(
    M=mesh,
    U_texture=path,
    DepthTestingEnabled=True,
    DepthWritingEnabled=True,
    DrawMode=4,
    FragmentShader="""#version 330

uniform vec3 _lightDirection[4];
uniform mat3 _worldToCameraNormal;
uniform sampler2D u_texture;

in  vec3 normal;
in vec2 texcoord;
in vec3 v_normal;
out vec4 fragment_color;

void main() {
  
  vec2 uv = v_normal.xy * 0.5 + 0.5;
  uv.y = 1.0 - uv.y;
  fragment_color = texture2D(u_texture, uv);
}""",
    GLShader=(0, 2, 0),
    PreviewSortOrder=5,
    VertexShader="""#version 330

layout(location = 0) in vec3 _meshVertex;
layout(location = 1) in vec3 _meshNormal;
layout(location = 2) in vec2 _meshTextureCoordinate;

uniform mat4 _worldToClip;
uniform mat3 _worldToCameraNormal;
out vec3 normal;
out vec3 v_normal;
out vec2 texcoord;

void main() {
  normal = _meshNormal;
  gl_Position = _worldToClip * vec4(_meshVertex , 1.0);
  v_normal = _worldToCameraNormal * normal;
  texcoord = _meshTextureCoordinate;
}""",
    glLineWidth=3,
    glPointSize=8)  # -> Color, Depth
