# Grasshopper definition half_tone_shader.gh (Grasshopper 1.0.7)
# plug-ins: ghgl

md_slider = MDSlider(
    SliderMode=0,
    slider_value=Point(0.7047506405, 0.4203796387, 0.5),
    x_domain=Domain(-1, 1),
    y_domain=Domain(-1, 1),
    z_domain=Domain(0, 1))
geo = Geometry(<mesh referenced from the Rhino model>)
gl_mesh = GLMeshShader(
    M=geo,
    Dir=md_slider,
    Div=Slider(12.14, range=0..50),
    Min_thickness=Slider(0.079, range=0..1),
    Max_thickness=Slider(0.853, range=0..1),
    DepthTestingEnabled=True,
    DepthWritingEnabled=True,
    DrawMode=4,
    FragmentShader="""#version 330

uniform vec3 _lightDirection[4];
uniform mat3 _worldToCameraNormal;
uniform vec3 dir;
uniform float div;
uniform float min_thickness;
uniform float max_thickness;

in  vec3 normal;
out vec4 fragment_color;

float map(float value, float low1, float high1, float low2, float high2){
  return low2 + (value - low1) * (high2 - low2) / (high1 - low1);
}

void main() {
  vec3 l = normalize(_lightDirection[0]);
  vec3 camNormal = _worldToCameraNormal * normal;
  float intensity = dot(l, normalize(camNormal.xyz));
  intensity = 1.0 - abs(intensity);
  intensity = map(intensity, 0.0, 1.0, min_thickness, max_thickness);
  
  vec2 fragCd = gl_FragCoord.xy;
  vec2 dir2d = normalize(dir.xy);
  float dist = dot(dir2d, fragCd);
  float modval = mod(dist, div) / div;
  
  float stepval = step(intensity, modval);
  
  fragment_color = vec4(vec3(stepval), 1.0);
}""",
    GLShader=(0, 2, 0),
    PreviewSortOrder=5,
    VertexShader="""#version 330

layout(location = 0) in vec3 _meshVertex;
layout(location = 1) in vec3 _meshNormal;

uniform mat4 _worldToClip;
out vec3 normal;

void main() {
  normal = _meshNormal;
  gl_Position = _worldToClip * vec4(_meshVertex , 1.0);
}""",
    glLineWidth=3,
    glPointSize=8)  # -> Color, Depth
