# Grasshopper definition outline_shader.gh (Grasshopper 1.0.7)
# plug-ins: ghgl

number_slider = Slider(1000, range=0..1000)
number_slider_2 = Slider(124, range=0..1000)
number_slider_3 = Slider(33, range=0..100)
rectangle = Rectangle(Plane=PlaneXY(0, 0, 0), XSize=number_slider, YSize=number_slider, Radius=0)  # -> Rectangle, Length
dom = ConstructDomain(DomainStart=Slider(26, range=0..100), DomainEnd=Slider(73, range=0..100))
random = Random(Range=Domain(0, 1), Number=number_slider_2, Seed=2, Integers=True)
colour = ColourPicker(PickedColour=RGB(0, 39, 46))
pop2d = Populate2D(Region=rectangle.Rectangle, Count=number_slider_3, Seed=number_slider_2)
random_2 = Random(Range=dom, Number=number_slider_3, Seed=2)
dispatch = Dispatch(List=pop2d, DispatchPattern=random)  # -> ListA, ListB
dispatch_2 = Dispatch(List=random_2, DispatchPattern=random)  # -> ListA, ListB
random_3 = Random(Range=Domain(0, 1), Number=number_slider_3, Seed=2)
pt = Point([Point(-1, -1, -1), Point(1, -1, -1), Point(1, 1, -1), Point(-1, 1, -1)])
sph = Sphere(Base=dispatch.ListA, Radius=dispatch_2.ListA)
box = CenterBox(Base=dispatch.ListB, X=dispatch_2.ListB, Y=dispatch_2.ListB, Z=dispatch_2.ListB)
hsl = ColourHSL(Alpha=1, Hue=random_3, Saturation=Slider(0.53, range=0..1), Luminance=Slider(0.82, range=0..1))
gl_shader = GLShader(
    Vertex=pt,
    Color=colour,
    Thickness=Slider(5.381, range=0..50),
    Res=Slider(16, range=0..32),
    DepthTestingEnabled=False,
    DepthWritingEnabled=False,
    DrawMode=6,
    FragmentShader="""#version 330 core
uniform sampler2D _depthBuffer;
uniform sampler2D _colorBuffer;

uniform vec2 _viewportSize;
uniform vec4 color;
uniform float thickness;
uniform float res;

void main() 
{
  vec2 uv = gl_FragCoord.xy / _viewportSize;

  vec4 buffer = texture(_depthBuffer, uv);
  float val = step(0.9999, buffer.x);
  float col = 1.0;
  float div = res;
  float stepang = 360.0 / div;
  for(float i = 0; i<div; i++){
    vec4 bufferP = texture(_depthBuffer, (gl_FragCoord.xy + vec2(cos(radians(stepang*i)), sin(radians(stepang*i)))*thickness) / _viewportSize);
    float valP = step(0.9999, bufferP.x);
    if(val - valP > 0.0){
      col *= 0.0;
    }
  }
  
  vec3 col3 = mix(color.xyz, texture(_colorBuffer, uv).xyz, col);
  
  gl_FragColor = vec4(vec3(col3), 1.0);
 
}""",
    GLShader=(0, 1, 0),
    PreviewSortOrder=5,
    VertexShader="""#version 330

layout(location = 0) in vec3 vertex;

out vec3 normal;

void main() {
  gl_Position = vec4(vertex,1.0);
}""",
    glLineWidth=3,
    glPointSize=8)
merge = Merge(Data1=sph, Data2=box)
preview = CustomPreview(Geometry=merge, Material=hsl)
