# Grasshopper definition CSVExport.gh (Grasshopper 1.0.7)

number_slider = Slider(100, range=0..100)
multiplication = Multiplication(A=number_slider, B=Slider(20, range=0..100))
random = Random(Range=Domain(0, 1), Number=multiplication, Seed=2)
partition = PartitionList(List=random, Size=number_slider)
flip = FlipMatrix(Data=partition)
join = TextJoin(Text=flip, Join=",")
flatten = FlattenTree(Tree=join, Path="{0}")
path = FilePath("C:\Users\jhorikawa\Desktop\sample.csv")
panel = Panel(flatten)
c_script = CSharpScript(save=Button(), path=path, data=flatten)  # inputs save: Boolean, path: String, data: list of String
# ---------- c_script: C# ----------
    if(save){
      var fileinfo = new System.IO.FileInfo(path);
      if(!fileinfo.Directory.Exists){
        fileinfo.Directory.Create();
      }
      
      var sw = fileinfo.CreateText();
      for(int i = 0; i < data.Count; i++){
        string row = data[i];
        if(i < data.Count - 1){
          sw.WriteLine(row);
        }else{
          sw.Write(row);
        }
      }
      
      sw.Flush();
      sw.Close();
    }
# ---------- end c_script ----------
