# Grasshopper definition skeletonization.gh (Grasshopper 1.0.7)
# plug-ins: Kangaroo Components

c_script = CSharpScript()  # -> out, A
# ---------- c_script: C# ----------
    var fonts = new System.Drawing.Text.InstalledFontCollection();
    var fontFamilies = fonts.Families;
    var fontNames = new List<string>();
    
    foreach(var fontFamily in fontFamilies){
      fontNames.Add(fontFamily.Name);
    }
    
    A = fontNames;
# ---------- end c_script ----------
panel = Panel(c_script.A)
item = ListItem(List=panel, Index=Slider(152, range=0..153), Wrap=True)
panel_2 = Panel("""あいうえお
かきくけこ
東西南北
薔薇綺麗
ABCDEFG
HIJKLMN""")
panel_3 = Panel(item)
xy = XYPlane(Origin=Point(0, 0, 0))
c_script_2 = CSharpScript(pos=xy, text=panel_2, font=panel_3, size=Slider(20, range=0..100))  # -> out, Srf, Outline; inputs pos: Plane, text: String, font: String, size: Double
# ---------- c_script_2: C# ----------
    var textEnt = new TextEntity();
    var textFont = new Rhino.DocObjects.Font(font);
    textEnt.PlainText = text;
    textEnt.Plane = pos;
    textEnt.Justification = TextJustification.BottomLeft;
    textEnt.Font = textFont;
    textEnt.TextHeight = size;

    var crvs = textEnt.CreateCurves(textEnt.DimensionStyle, false);
    var srfs = textEnt.CreateSurfaces(textEnt.DimensionStyle);

    Srf = srfs;
    Outline = crvs;
# ---------- end c_script_2 ----------
boundary = BoundarySurfaces(Edges=c_script_2.Outline)
graft = GraftTree(Tree=boundary, IncludeEmptyLists=True, IncludeNullItems=True)  # -> simplify(Tree)
edges = BrepEdges(Brep=graft)  # -> simplify(Naked), Interior, NonManifold
bbox = BoundingBox(Content=graft, Plane=PlaneXY(0, 0, 0))  # -> simplify(Box), Box_2
join = JoinCurves(Curves=edges.Naked, Preserve=False)  # -> simplify(Curves)
area = Area(Geometry=bbox.Box)  # -> Area, Centroid
len = Length(Curve=join)
scale = Scale(Geometry=bbox.Box, Center=area.Centroid, Factor="1.5")  # -> Geometry, Transform
division = Division(A=len, B=Slider(0.504, range=0..1))
divide = DivideCurve(Curve=join, Count=division, Kinks=False)  # -> Points, Tangents, Parameters
pshift = ShiftPaths(Data=divide.Points, Offset=-1)
voronoi = Voronoi(Points=pshift, Boundary=scale.Geometry, Plane=xy, BruteForceOverride=False)  # -> simplify(Cells)
project = Project(Curve=voronoi, Brep=graft, Direction=Vector(0, 0, 1))
explode = Explode(Curve=project, Recursive=True)  # -> Segments, Vertices
pshift_2 = ShiftPaths(Data=explode.Segments, Offset=-2)
dupln = RemoveDuplicateLines(Lines=pshift_2, Tolerance=0.001)
c_script_3 = CSharpScript(crvs=dupln, outlines=join)  # -> out, A; inputs crvs: list of Curve, outlines: list of Curve
# ---------- c_script_3: C# ----------
    //var spt = crv.PointAtStart;
    //var ept = crv.PointAtEnd;
    List<Curve> outCrvs = new List<Curve>();

    foreach(var crv in crvs){
      Point3d ptOnC;
      Point3d ptOnO;
      int which;
      var cp = crv.ClosestPoints(outlines, out ptOnC, out ptOnO, out which);
      
      var dist = ptOnC.DistanceTo(ptOnO);

      if(dist > 0.01){
        outCrvs.Add(crv);
      }
    }

    A = outCrvs;
# ---------- end c_script_3 ----------
line = Line(c_script_3.A)
c_script_4 = CSharpScript(lines=line, trim=Slider(2, range=0..4))  # -> out, A, B; inputs lines: list of Line, trim: Double
# ---------- c_script_4: C# ----------
    var pts = new List<Point3d>();
    var neighbours = new List<List<int>>();

    foreach(var line in lines){
      var res1 = pts.FindIndex(pt => pt.DistanceTo(line.From) < 0.001);
      if(res1 < 0){
        pts.Add(line.From);
        neighbours.Add(new List<int>());
      }

      var res2 = pts.FindIndex(pt => pt.DistanceTo(line.To) < 0.001);
      if(res2 < 0){
        pts.Add(line.To);
        neighbours.Add(new List<int>());
      }
    }

    for(int i = 0; i < pts.Count; i++)
    {
      var pt = pts[i];
      var aLines1 = lines.FindAll(line => line.To.DistanceTo(pt) < 0.001);
      foreach(var aLine in aLines1){
        var index = pts.FindIndex(p => p.DistanceTo(aLine.From) < 0.001);
        if(neighbours[i].FindIndex(neigh => neigh == index) < 0){
          neighbours[i].Add(index);
        }
      }

      var aLines2 = lines.FindAll(line => line.From.DistanceTo(pt) < 0.001);
      foreach(var aLine in aLines2){
        var index = pts.FindIndex(p => p.DistanceTo(aLine.To) < 0.001);
        if(neighbours[i].FindIndex(neigh => neigh == index) < 0){
          neighbours[i].Add(index);
        }
      }
    }

    var removePointIndexes = new List<int>();
    for(int i = 0; i < pts.Count; i++){
      var neigh = neighbours[i];
      var pt = pts[i];
      if(neigh.Count == 1){
        var visited = new List<int>();
        int count = 0;
        int npt = neigh[0];
        var curlen = 0.0;
        visited.Add(i);

        while(true){
          var npts = neighbours[npt];
          if(npts.Count != 2){
            break;
          }else{
            var prevpos = pts[visited[visited.Count - 1]];
            var npos = pts[npt];
            var dist = prevpos.DistanceTo(npos);
            curlen += dist;

            if(curlen < trim){
              visited.Add(npt);
              for(int n = 0; n < npts.Count; n++){
                int tnpt = npts[n];
                if(visited.FindIndex(visit => visit == tnpt) < 0){
                  npt = tnpt;
                }
              }
            }else{
              break;
            }
          }
          count += 1;
        }

        for(int n = 0; n < visited.Count; n++){
          if(removePointIndexes.FindIndex(rindex => rindex == visited[n]) < 0){
            removePointIndexes.Add(visited[n]);
          }
        }
      }
    }
    
    removePointIndexes.Sort();
    removePointIndexes.Reverse();
    
    
    
    foreach(var rindex in removePointIndexes){
      var pt = pts[rindex];
      var removeLines = lines.FindAll(line => line.To.DistanceTo(pt) < 0.001 || line.From.DistanceTo(pt) < 0.001);
      foreach(var removeLine in removeLines){
        lines.Remove(removeLine);
      }
      
      pts.RemoveAt(rindex);
    }

    A = pts;
    B = lines;
# ---------- end c_script_4 ----------
crv = Curve(c_script_4.B)
join_2 = JoinCurves(Curves=crv, Preserve=False)  # -> simplify(Curves)
cp = ControlPoints(Curve=join_2)  # -> Points, Weights, Knots
lng = ListLength(List=cp.Points)
multiplication = Multiplication(A=lng, B=Slider(0.5, range=0..1))
reb = RebuildCurve(Curve=graft(join_2), Degree=Slider(3, range=0..10), Count=multiplication, Tangents=False)
Z = UnitZ(Factor=Slider(5, range=0..10))
extr = Extrude(Base=reb, Direction=Z)
preview = CustomPreview(Geometry=reb, Material=ColourSwatch(SwatchColor=RGB(0, 0, 0)))
preview_2 = CustomPreview(Geometry=extr, Material=ColourSwatch(SwatchColor=RGB(255, 0, 0)))
