# Grasshopper definition Graham Scan with Grasshopper C#.gh (Grasshopper 1.0.7)

cir = Circle(Plane=PlaneXY(0, 0, 0), Radius=Slider(100, range=0..100))
boundary = BoundarySurfaces(Edges=cir)
popgeo = PopulateGeometry(Geometry=boundary, Count=Slider(61, range=0..100), Seed=Slider(622, range=0..1000))
c_script = CSharpScript(pts=popgeo)  # -> out, CPts, CHull; inputs pts: list of Point3d
# ---------- c_script: C# usings ----------
using System.Linq;
# ---------- c_script: C# ----------
    pts = pts.OrderBy(pt => pt.Y).ToList();
    pts = pts.OrderBy(pt => Math.Atan2(pt.Y - pts[0].Y, pt.X - pts[0].X)).ToList();
    
    List<Point3d> selPts = new List<Point3d>();
    
    while(pts.Count > 0){
      GrahamScan(ref pts, ref selPts);
    };
    
    
    
    CPts = selPts;
    
    selPts.Add(selPts[0]);
    CHull = new Polyline(selPts);
# ---------- c_script: C# additional code ----------
  void GrahamScan(ref List<Point3d> pts, ref List<Point3d> selPts){
    if(pts.Count > 0){
      var pt = pts[0];
      
      if(selPts.Count <= 1){
        selPts.Add(pt);
        pts.RemoveAt(0);
      }else{
        var pt1 = selPts[selPts.Count - 1];
        var pt2 = selPts[selPts.Count - 2];
        Vector3d dir1 = pt1 - pt2;
        Vector3d dir2 = pt - pt1;
        var cross = Vector3d.CrossProduct(dir1, dir2);
        
        if(cross.Z < 0){
          selPts.RemoveAt(selPts.Count - 1);
        }else{
          selPts.Add(pt);
          pts.RemoveAt(0);
        }
      }
    }
  }
# ---------- end c_script ----------
boundary_2 = BoundarySurfaces(Edges=c_script.CHull)
panel = Panel(c_script.CPts)
