# Grasshopper definition Export Geometry with Grasshopper C#.gh (Grasshopper 1.0.7)

range = Range(Domain=Domain(0, 1), Steps=Slider(100, range=0..100))
yz = YZPlane(Origin=Point(0, 0, 0))
pi = Pi(Factor=Slider(10.715, range=0..30))
cull_i = CullIndex(List=range, Indices="0", Wrap=True)
polygon = Polygon(Plane=yz, Radius=3, Segments=Slider(5, range=0..10), FilletRadius=0)  # -> Polygon, Length
multiplication = Multiplication(A=Slider(24.18, range=0..100), B=cull_i)
multiplication_2 = Multiplication(A=pi, B=cull_i)
scale = Scale(Geometry=polygon.Polygon, Center=Point(0, 0, 0), Factor=cull_i)  # -> Geometry, Transform
X = UnitX(Factor=multiplication)
move = Move(Geometry=scale.Geometry, Motion=X)  # -> Geometry, Transform
rotate = Rotate(Geometry=move.Geometry, Angle=multiplication_2, Plane=PlaneXY(0, 0, 0))  # -> Geometry, Transform
boundary = BoundarySurfaces(Edges=rotate.Geometry)
geo = Geometry(boundary)
path = FilePath("F:\odrive\Google Drive\JH\Projects\[114] GrasshopperPlugins\Tutorials\Files\0015 Export Geometry with Grasshopper C#\")
preview = CustomPreview(
    Geometry=geo,
    Material={diffuse=RGB(221, 160, 221), emission=RGB(66, 48, 66), shine=0.5, specular=RGB(255, 255, 255), transparency=0})
c_script = CSharpScript(geometries=geo, filename="sample.3dm", directory=path, export=Toggle(False))  # inputs geometries: tree of GeometryBase, filename: String, directory: String, export: Boolean
# ---------- c_script: C# usings ----------
using System.IO;
# ---------- c_script: C# ----------
    if(export){

      var guids = new List<Guid>();

      for(int i = 0; i < geometries.BranchCount; i++){
        for(int n = 0; n < geometries.Branches[i].Count; n++){
          var geom = geometries.Branches[i][n];
          var guid = Rhino.RhinoDoc.ActiveDoc.Objects.Add(geom);
          guids.Add(guid);
        }
      }

      Rhino.RhinoDoc.ActiveDoc.Objects.Select(guids);

      string filepath = Path.Combine(directory, filename);
      string cmd = "_-Export " + "\"" + filepath + "\"" + " _Enter _Enter";

      Rhino.RhinoApp.RunScript(cmd, false);

      Rhino.RhinoDoc.ActiveDoc.Objects.Delete(guids, true);
    }
# ---------- end c_script ----------
