# Grasshopper definition Import Geometry with Grasshopper C#.gh (Grasshopper 1.0.7)

path = FilePath("F:\odrive\Google Drive\JH\Projects\[114] GrasshopperPlugins\Tutorials\Files\0016 Import Geometry with Grasshopper C#\v6_rhino_logo.obj")
c_script = CSharpScript(file=path, import=Toggle(False), reset=Button())  # -> out, geometries; inputs file: String, import: Boolean, reset: Boolean
# ---------- c_script: C# usings ----------
using System.Linq;
using Rhino.DocObjects;
# ---------- c_script: C# ----------
    if(import){
      RhinoDoc.ActiveDoc.Objects.UnselectAll();
      string cmd = "!_-Import " + "\"" + file + "\"" + " _Enter";
      Rhino.RhinoApp.RunScript(cmd, false);
      var selectedObjs = RhinoDoc.ActiveDoc.Objects.GetSelectedObjects(false, false).ToList();
      geos = new List<GeometryBase>();
      foreach(RhinoObject selectedObj in selectedObjs){
        var geo = selectedObj.Geometry;
        geos.Add(geo);
        RhinoDoc.ActiveDoc.Objects.Delete(selectedObj, true);
      }
    }
    
    if(reset){
      geos.Clear();
    }
    

    geometries = geos;
# ---------- c_script: C# additional code ----------
  private List<GeometryBase> geos = new List<GeometryBase>();
# ---------- end c_script ----------
panel = Panel(c_script.geometries)
