# Grasshopper definition chandelier.gh (Grasshopper 1.0.7)

ang = Slider(8, range=0..10)
lengthpow = Slider(0.46, range=0..2)
dist = Slider(1000, range=0..1000)
num = Slider(289, range=0..1000)
angpow = Slider(1.7, range=0..10)
topoffset = Slider(682, range=0..1000)
maxlength = Slider(4739, range=0..10000)
minlength = Slider(2, range=0..10000)
thickness = Slider(1, range=0..1)
# Step 3:
# Rotate points to create spiral.
number_slider = Slider(35, range=0..200)
# Step 2:
# Create list of points.
md_slider = MDSlider(
    SliderMode=0,
    slider_value=Point(0.391815968, 0.5721224271, 0.5),
    x_domain=Domain(0, 1),
    y_domain=Domain(0, 1),
    z_domain=Domain(0, 1))
# Step 1:
# Create two points.
md_slider_2 = MDSlider(
    SliderMode=0,
    slider_value=Point(0.391815968, 0.5721224271, 0.5),
    x_domain=Domain(0, 1),
    y_domain=Domain(0, 1),
    z_domain=Domain(0, 1))
md_slider_3 = MDSlider(SliderMode=0, slider_value=Point(0, 0, 0.5), x_domain=Domain(0, 1), y_domain=Domain(0, 1), z_domain=Domain(0, 1))
# Step 4:
# Modify spiral shape.
md_slider_4 = MDSlider(SliderMode=0, slider_value=Point(0, 0, 0.5), x_domain=Domain(0, 1), y_domain=Domain(0, 1), z_domain=Domain(0, 1))
pi = Pi(Factor=Slider(10, range=0..10))
multiplication = Multiplication(A=md_slider, B=Slider(1000, range=0..1000))
pi_2 = Pi(Factor=Slider(10, range=0..10))
multiplication_2 = Multiplication(A=md_slider_2, B=Slider(1000, range=0..1000))
multiplication_3 = Multiplication(A=md_slider_3, B=Slider(1000, range=0..1000))
multiplication_4 = Multiplication(A=md_slider_4, B=Slider(1000, range=0..1000))
c_script = CSharpScript(pos=multiplication, dist=Slider(923, range=0..1000), num=number_slider)  # -> out, A; inputs pos: Point3d, dist: Double, num: Int32
# ---------- c_script: C# ----------
    var pts = new List<Point3d>();
    for(int i = 0; i < num; i++){
      var newpos = pos + new Vector3d(dist * i / (num - 1.0), 0, 0);
      pts.Add(newpos);
    }

    A = pts;
# ---------- end c_script ----------
c_script_2 = CSharpScript(pos=multiplication_2, dist=Slider(923, range=0..1000))  # -> out, A; inputs pos: Point3d, dist: Double
# ---------- c_script_2: C# ----------
    var pts = new List<Point3d>(){
        pos,
        pos + new Point3d(dist, 0, 0)
        };

    A = pts;
# ---------- end c_script_2 ----------
c_script_3 = CSharpScript(pos=multiplication_3, dist=Slider(1000, range=0..1000), num=Slider(200, range=0..200), ang=pi)  # -> out, A; inputs pos: Point3d, dist: Double, num: Int32, ang: Double
# ---------- c_script_3: C# ----------
    var pts = new List<Point>();
    for(int i = 0; i < num; i++){
      double t = i / (num - 1.0);
      
      var newpos = pos + new Vector3d(dist * t, 0, 0);
      var newpt = new Point(newpos);
      newpt.Rotate(t * ang, Vector3d.ZAxis, pos);

      pts.Add(newpt);
    }

    A = pts;
# ---------- end c_script_3 ----------
c_script_4 = CSharpScript(
    pos=multiplication_4,
    dist=Slider(1000, range=0..1000),
    num=Slider(200, range=0..200),
    ang=pi_2,
    angpow=Slider(1.61, range=0..2))  # -> out, A; inputs pos: Point3d, dist: Double, num: Int32, ang: Double, angpow: Double
# ---------- c_script_4: C# ----------
    var pts = new List<Point>();
    for(int i = 0; i < num; i++){
      double t = i / (num - 1.0);

      var newpos = pos + new Vector3d(dist * t, 0, 0);
      var newpt = new Point(newpos);
      newpt.Rotate(Math.Pow(t, angpow) * ang, Vector3d.ZAxis, pos);

      pts.Add(newpt);
    }

    A = pts;
# ---------- end c_script_4 ----------
range = Range(Domain=Domain(0, 1), Steps=num)
multiplication_5 = Multiplication(A=range, B=dist)
pow = Power(A=range, B=angpow)
pi_3 = Pi(Factor=ang)
X = UnitX(Factor=multiplication_5)
pt = ConstructPoint(XCoordinate=0, YCoordinate=0, ZCoordinate=0)
multiplication_6 = Multiplication(A=pow, B=pi_3)
pow_2 = Power(A=range, B=lengthpow)
move = Move(Geometry=pt, Motion=X)  # -> Geometry, Transform
bnd = Bounds(Numbers=pow_2)
dom = ConstructDomain(DomainStart=maxlength, DomainEnd=minlength)
# Step 7:
# Move curve downward.
md_slider_5 = MDSlider(SliderMode=0, slider_value=Point(0, 0, 0.5), x_domain=Domain(0, 1), y_domain=Domain(0, 1), z_domain=Domain(0, 1))
# Step 6:
# Divide curve equally.
md_slider_6 = MDSlider(SliderMode=0, slider_value=Point(0, 0, 0.5), x_domain=Domain(0, 1), y_domain=Domain(0, 1), z_domain=Domain(0, 1))
rotate = Rotate(Geometry=move.Geometry, Angle=multiplication_6, Plane=PlaneXY(0, 0, 0))  # -> Geometry, Transform
# Step 5:
# Create interpolate curve from points.
md_slider_7 = MDSlider(SliderMode=0, slider_value=Point(0, 0, 0.5), x_domain=Domain(0, 1), y_domain=Domain(0, 1), z_domain=Domain(0, 1))
remap = RemapNumbers(Value=pow_2, Source=bnd, Target=dom)  # -> Mapped, Clipped
pi_4 = Pi(Factor=Slider(10, range=0..10))
nurbs = NurbsCurve(Vertices=rotate.Geometry, Degree=3, Periodic=False)  # -> Curve, Length, Domain
pi_5 = Pi(Factor=Slider(10, range=0..10))
pi_6 = Pi(Factor=Slider(10, range=0..10))
multiplication_7 = Multiplication(A=range, B=topoffset)
multiplication_8 = Multiplication(A=md_slider_5, B=Slider(2583, range=0..5000))
multiplication_9 = Multiplication(A=md_slider_6, B=Slider(1000, range=0..1000))
multiplication_10 = Multiplication(A=md_slider_7, B=Slider(1000, range=0..1000))
divide = DivideCurve(Curve=nurbs.Curve, Count=num, Kinks=False)  # -> Points, Tangents, Parameters
c_script_5 = CSharpScript(
    pos=multiplication_10,
    dist=Slider(1000, range=0..1000),
    num=Slider(200, range=0..200),
    ang=pi_6,
    angpow=Slider(1.61, range=0..2))  # -> out, Rail; inputs pos: Point3d, dist: Double, num: Int32, ang: Double, angpow: Double
# ---------- c_script_5: C# ----------
    var pts = new List<Point3d>();
    for(int i = 0; i < num; i++){
      double t = i / (num - 1.0);

      var newpos = pos + new Vector3d(dist * t, 0, 0);
      var newpt = new Point(newpos);
      newpt.Rotate(Math.Pow(t, angpow) * ang, Vector3d.ZAxis, pos);

      pts.Add(newpt.Location);
    }

    var crv = Curve.CreateInterpolatedCurve(pts, 3);

    Rail = crv;
# ---------- end c_script_5 ----------
len = Length(Curve=nurbs.Curve)
c_script_6 = CSharpScript(
    pos=multiplication_8,
    dist=Slider(1000, range=0..1000),
    num=Slider(200, range=0..200),
    ang=pi_4,
    angpow=Slider(1.56, range=0..2),
    topoffset=Slider(636, range=0..1000))  # -> out, Rail, A; inputs pos: Point3d, dist: Double, num: Int32, ang: Double, angpow: Double, topoffset: Double
# ---------- c_script_6: C# ----------
    var pts = new List<Point3d>();
    for(int i = 0; i < num; i++){
      double t = i / (num - 1.0);

      var newpos = pos + new Vector3d(dist * t, 0, 0);
      var newpt = new Point(newpos);
      newpt.Rotate(Math.Pow(t, angpow) * ang, Vector3d.ZAxis, pos);

      pts.Add(newpt.Location);
    }

    var crv = Curve.CreateInterpolatedCurve(pts, 3);

    var newpts = new List<Point3d>();
    var divs = crv.DivideByCount(num - 1, true);
    for(int i = 0; i < divs.Length; i++){
      var newpos = crv.PointAt(divs[i]);
      double t = i / (divs.Length - 1.0);
      double offset = topoffset * t;
      newpos += new Vector3d(0, 0, -offset);
      newpts.Add(newpos);
    }
    crv = Curve.CreateInterpolatedCurve(newpts, 3);

    Rail = crv;
    A = newpts;
# ---------- end c_script_6 ----------
Z = UnitZ(Factor=multiplication_7)
c_script_7 = CSharpScript(
    pos=multiplication_9,
    dist=Slider(1000, range=0..1000),
    num=Slider(200, range=0..200),
    ang=pi_5,
    angpow=Slider(1.56, range=0..2))  # -> out, Rail, A; inputs pos: Point3d, dist: Double, num: Int32, ang: Double, angpow: Double
# ---------- c_script_7: C# ----------
    var pts = new List<Point3d>();
    for(int i = 0; i < num; i++){
      double t = i / (num - 1.0);

      var newpos = pos + new Vector3d(dist * t, 0, 0);
      var newpt = new Point(newpos);
      newpt.Rotate(Math.Pow(t, angpow) * ang, Vector3d.ZAxis, pos);

      pts.Add(newpt.Location);
    }

    var crv = Curve.CreateInterpolatedCurve(pts, 3);
    var newpts = new List<Point3d>();
    var divs = crv.DivideByCount(num - 1, true);
    for(int i = 0; i < divs.Length; i++){
      var newpos = crv.PointAt(divs[i]);
      newpts.Add(newpos);
    }


    Rail = crv;
    A = newpts;
# ---------- end c_script_7 ----------
Z_2 = UnitZ(Factor=1)
neg = Negative(Value=Z)
division = Division(A=len, B=num)
move_2 = Move(Geometry=divide.Points, Motion=neg)  # -> Geometry, Transform
neg_2 = Negative(Value=Z_2)
multiplication_11 = Multiplication(A=division, B="0.5")
line = LineSDL(Start=move_2.Geometry, Direction=neg_2, Length=remap.Mapped)
intcrv = Interpolate(Vertices=move_2.Geometry, Degree=3, Periodic=False, KnotStyle=1)  # -> Curve, Length, Domain
multiplication_12 = Multiplication(A=thickness, B=multiplication_11)
pipe = Pipe(Curve=line, Radius=multiplication_12, Caps=0)
pipe_2 = Pipe(Curve=intcrv.Curve, Radius=multiplication_12, Caps=0)
# Step 9:
# Create pipes from lines.
md_slider_8 = MDSlider(SliderMode=0, slider_value=Point(0, 0, 0.5), x_domain=Domain(0, 1), y_domain=Domain(0, 1), z_domain=Domain(0, 1))
# Step 8:
# Create lines.
md_slider_9 = MDSlider(SliderMode=0, slider_value=Point(0, 0, 0.5), x_domain=Domain(0, 1), y_domain=Domain(0, 1), z_domain=Domain(0, 1))
merge = Merge(Data1=pipe_2, Data2=pipe)
pi_7 = Pi(Factor=Slider(8, range=0..10))
pi_8 = Pi(Factor=Slider(8.3, range=0..10))
multiplication_13 = Multiplication(A=md_slider_8, B=Slider(2432, range=0..5000))
preview = CustomPreview(
    Geometry=merge,
    Material={diffuse=RGB(221, 160, 221), emission=RGB(66, 48, 66), shine=0.5, specular=RGB(255, 255, 255), transparency=0})
multiplication_14 = Multiplication(A=md_slider_9, B=Slider(2583, range=0..5000))
c_script_8 = CSharpScript(
    pos=multiplication_13,
    dist=Slider(1000, range=0..1000),
    num=Slider(200, range=0..200),
    ang=pi_7,
    angpow=Slider(1.52, range=0..2),
    topoffset=Slider(620, range=0..1000),
    minlength=Slider(61, range=0..1000),
    maxlength=Slider(5000, range=0..5000),
    lengthpow=Slider(0.366, range=0..5),
    thickness=Slider(1, range=0..1))  # -> out, Rail, Pipes; inputs pos: Point3d, dist: Double, num: Int32, ang: Double, angpow: Double, topoffset: Double, minlength: Double, maxlength: Double, lengthpow: Double, thickness: Double
# ---------- c_script_8: C# ----------
    var pts = new List<Point3d>();
    for(int i = 0; i < num; i++){
      double t = i / (num - 1.0);

      var newpos = pos + new Vector3d(dist * t, 0, 0);
      var newpt = new Point(newpos);
      newpt.Rotate(Math.Pow(t, angpow) * ang, Vector3d.ZAxis, pos);

      pts.Add(newpt.Location);
    }

    var crv = Curve.CreateInterpolatedCurve(pts, 3);

    var lines = new List<Curve>();

    var newpts = new List<Point3d>();
    var divs = crv.DivideByCount(num - 1, true);

    var sepdist = crv.GetLength() / num;
    var pipeList = new List<Brep>();
    for(int i = 0; i < divs.Length; i++){
      var newpos = crv.PointAt(divs[i]);
      double t = i / (divs.Length - 1.0);
      double offset = topoffset * t;
      newpos += new Vector3d(0, 0, -offset);
      newpts.Add(newpos);

      var len = minlength + (maxlength - minlength) * (1.0 - Math.Pow(t, lengthpow));
      var lc = new LineCurve(newpos, newpos + new Vector3d(0, 0, -len));
      lines.Add(lc);

      var pipes = Brep.CreatePipe(lc, sepdist * 0.5 * thickness, true, PipeCapMode.None, true, 0.01, 0.01);
      pipeList.AddRange(pipes);
    }
    crv = Curve.CreateInterpolatedCurve(newpts, 3);
    var rail = Brep.CreatePipe(crv, sepdist * 0.5 * thickness, true, PipeCapMode.Round, true, 0.01, 0.01);

    Rail = rail;
    Pipes = pipeList;
# ---------- end c_script_8 ----------
c_script_9 = CSharpScript(
    pos=multiplication_14,
    dist=Slider(1000, range=0..1000),
    num=Slider(200, range=0..200),
    ang=pi_8,
    angpow=Slider(0.86, range=0..2),
    topoffset=Slider(627, range=0..1000),
    minlength=Slider(214, range=0..1000),
    maxlength=Slider(5000, range=0..5000),
    lengthpow=Slider(0.44, range=0..5))  # -> out, Rail, Lines; inputs pos: Point3d, dist: Double, num: Int32, ang: Double, angpow: Double, topoffset: Double, minlength: Double, maxlength: Double, lengthpow: Double
# ---------- c_script_9: C# ----------
    var pts = new List<Point3d>();
    for(int i = 0; i < num; i++){
      double t = i / (num - 1.0);

      var newpos = pos + new Vector3d(dist * t, 0, 0);
      var newpt = new Point(newpos);
      newpt.Rotate(Math.Pow(t, angpow) * ang, Vector3d.ZAxis, pos);

      pts.Add(newpt.Location);
    }

    var crv = Curve.CreateInterpolatedCurve(pts, 3);

    var lines = new List<Curve>();

    var newpts = new List<Point3d>();
    var divs = crv.DivideByCount(num - 1, true);
    for(int i = 0; i < divs.Length; i++){
      var newpos = crv.PointAt(divs[i]);
      double t = i / (divs.Length - 1.0);
      double offset = topoffset * t;
      newpos += new Vector3d(0, 0, -offset);
      newpts.Add(newpos);

      var len = minlength + (maxlength - minlength) * (1.0 - Math.Pow(t, lengthpow));
      var lc = new LineCurve(newpos, newpos + new Vector3d(0, 0, -len));
      lines.Add(lc);
    }
    crv = Curve.CreateInterpolatedCurve(newpts, 3);

    Rail = crv;
    Lines = lines;
# ---------- end c_script_9 ----------
merge_2 = Merge(Data1=c_script_8.Rail, Data2=c_script_8.Pipes)
preview_2 = CustomPreview(
    Geometry=merge_2,
    Material={diffuse=RGB(221, 160, 221), emission=RGB(66, 48, 66), shine=0.5, specular=RGB(255, 255, 255), transparency=0})
