# Grasshopper definition CustomPopulateGeometry1.gh (Grasshopper 1.0.7)

number_slider = Slider(1000, range=0..1000)
planesrf = PlaneSurface(Plane=PlaneXY(0, 0, 0), XSize=number_slider, YSize=number_slider)
popgeo = PopulateGeometry(Geometry=planesrf, Count=Slider(3, range=0..10), Seed=1)
nurbs = NurbsCurve(Vertices=popgeo, Degree=2, Periodic=False)  # -> Curve, Length, Domain
divide = DivideCurve(Curve=nurbs.Curve, Count=Slider(60, range=0..100), Kinks=False)  # -> Points, Tangents, Parameters
filter = StreamFilter(Gate=Toggle(True), Stream0=popgeo, Stream1=divide.Points)
c_script = CSharpScript(
    brep=planesrf,
    attractors=filter,
    num=Slider(1000, range=0..1000),
    ite=Slider(50, range=10..100),
    attractor_rad=Slider(1000, range=0..2000),
    attractor_pow=Slider(-0.45, range=-1..1))  # -> out, A; inputs brep: Brep, attractors: list of Point3d, num: Int32, ite: Int32, attractor_rad: Double, attractor_pow: Double
# ---------- c_script: C# usings ----------
using Rhino.Collections;
# ---------- c_script: C# ----------
    var points = new Point3dList();

    if(brep != null){
      var attracts = new Point3dList(attractors);
      var rnd = new Random();
      var bbox = brep.GetBoundingBox(true);

      for(int i = 0; i < num; i++){

        if(points.Count == 0){
          var rndpt = CreateRandomPoint(rnd, brep, bbox);
          points.Add(rndpt);
        }else{

          double fdist = -1;
          Point3d fpos = new Point3d();
          for(int t = 0; t < Math.Max(Math.Min(ite, i), 10); t++){
            var nrndpt = CreateRandomPoint(rnd, brep, bbox);
            var nindex = points.ClosestIndex(nrndpt);
            var npos = points[nindex];

            var nattractid = attracts.ClosestIndex(nrndpt);
            var nattractpos = attracts[nattractid];
            var mindist = attractor_rad;
            var pow = attractor_pow;
            var nattractdist = Math.Pow(Remap(Math.Min(nattractpos.DistanceTo(nrndpt), mindist), 0, mindist, 0, 1.0), pow);

            var ndist = npos.DistanceTo(nrndpt) * nattractdist;

            if(fdist < ndist){
              fdist = ndist;
              fpos = nrndpt;
            }
          }
          points.Add(fpos);
        }
      }
    }

    A = points;
# ---------- c_script: C# additional code ----------
  double Remap(double val, double smin, double smax, double tmin, double tmax){
    return (val - smin) / (smax - smin) * (tmax - tmin) + tmin;
  }

  Point3d CreateRandomPoint(Random rnd, Brep brep, BoundingBox bbox){
    var x = Remap(rnd.NextDouble(), 0.0, 1.0, bbox.Min.X, bbox.Max.X);
    var y = Remap(rnd.NextDouble(), 0.0, 1.0, bbox.Min.Y, bbox.Max.Y);
    var z = Remap(rnd.NextDouble(), 0.0, 1.0, bbox.Min.Z, bbox.Max.Z);

    return brep.ClosestPoint(new Point3d(x, y, z));
  }
# ---------- end c_script ----------
sph = Sphere(Base=filter, Radius=Slider(10, range=0..40))
preview = CustomPreview(Geometry=sph, Material=ColourSwatch(SwatchColor=RGB(255, 212, 0)))
preview_2 = CustomPreview(Geometry=c_script.A, Material=ColourSwatch(SwatchColor=RGB(0, 0, 0)))
