# Grasshopper definition CustomPopulateGeometry2.gh (Grasshopper 1.0.7)
# plug-ins: Weaverbird

pt = ConstructPoint(XCoordinate=0, YCoordinate=0, ZCoordinate=0)
X = UnitX(Factor=1)
pi = Pi(Factor=1)
arc = Arc(Plane=pt, Radius=Slider(500, range=0..1000), Angle=Domain(0, 3.141592654))  # -> Arc, Length
line = LineSDL(Start=pt, Direction=X, Length=1)
revsrf = Revolution(Curve=arc.Arc, Axis=line, Domain=pi)
scale_nu = ScaleNU(
    Geometry=revsrf,
    Plane=PlaneXY(0, 0, 0),
    ScaleX=Slider(1, range=0..1),
    ScaleY=Slider(0.63, range=0..1),
    ScaleZ=Slider(0.35, range=0..1))  # -> Geometry, Transform
edges = BrepEdges(Brep=scale_nu.Geometry)  # -> Naked, Interior, NonManifold
preview = CustomPreview(Geometry=scale_nu.Geometry, Material=ColourSwatch(SwatchColor=RGB(105, 207, 255)))
divlength = DivideLength(Curve=edges.Naked, Length=Slider(50, range=0..100))  # -> Points, Tangents, Parameters
flatten = FlattenTree(Tree=divlength.Points, Path="{0}")
geo = Geometry(scale_nu.Geometry)
bbox = BoundingBox(Content=geo, Plane=PlaneXY(0, 0, 0))  # -> Box, Box_2
c_script = CSharpScript(
    brep=geo,
    attractors=flatten,
    num=Slider(500, range=0..1000),
    ite=Slider(50, range=10..100),
    attractor_rad=Slider(1000, range=0..2000),
    attractor_pow=Slider(-0.5, range=-1..1))  # -> out, A; inputs brep: Brep, attractors: list of Point3d, num: Int32, ite: Int32, attractor_rad: Double, attractor_pow: Double
# ---------- c_script: C# usings ----------
using Rhino.Collections;
# ---------- c_script: C# ----------
    var points = new Point3dList();

    var attracts = new Point3dList(attractors);
    var rnd = new Random();
    var bbox = brep.GetBoundingBox(true);

    for(int i = 0; i < num; i++){

      if(points.Count == 0){
        var rndpt = CreateRandomPoint(rnd, brep, bbox);
        points.Add(rndpt);
      }else{

        double fdist = -1;
        Point3d fpos = new Point3d();
        for(int t = 0; t < Math.Max(Math.Min(ite, i), 10); t++){
          var nrndpt = CreateRandomPoint(rnd, brep, bbox);
          var nindex = points.ClosestIndex(nrndpt);
          var npos = points[nindex];

          var nattractid = attracts.ClosestIndex(nrndpt);
          var nattractpos = attracts[nattractid];
          var mindist = attractor_rad;
          var pow = attractor_pow;
          var nattractdist = Math.Pow(Remap(Math.Min(nattractpos.DistanceTo(nrndpt), mindist), 0, mindist, 0, 1.0), pow);

          var ndist = npos.DistanceTo(nrndpt) * nattractdist;

          if(fdist < ndist){
            fdist = ndist;
            fpos = nrndpt;
          }
        }
        points.Add(fpos);
      }
    }

    A = points;
# ---------- c_script: C# additional code ----------
  double Remap(double val, double smin, double smax, double tmin, double tmax){
    return (val - smin) / (smax - smin) * (tmax - tmin) + tmin;
  }

  Point3d CreateRandomPoint(Random rnd, Brep brep, BoundingBox bbox){
    var x = Remap(rnd.NextDouble(), 0.0, 1.0, bbox.Min.X, bbox.Max.X);
    var y = Remap(rnd.NextDouble(), 0.0, 1.0, bbox.Min.Y, bbox.Max.Y);
    var z = Remap(rnd.NextDouble(), 0.0, 1.0, bbox.Min.Z, bbox.Max.Z);

    return brep.ClosestPoint(new Point3d(x, y, z));
  }
# ---------- end c_script ----------
area = Area(Geometry=bbox.Box)  # -> Area, Centroid
scale = Scale(Geometry=bbox.Box, Center=area.Centroid, Factor=Slider(1.2, range=0..10))  # -> Geometry, Transform
voronoi³ = Voronoi3D(Points=c_script.A, Box=scale.Geometry)  # -> Cells, Boundary
bbx = BrepBrep(BrepA=voronoi³.Cells, BrepB=geo)  # -> simplify(Curves), Points
flatten_2 = FlattenTree(Tree=bbx.Curves, Path="{0}")
cls = Closed(Curve=flatten_2)  # -> Closed, Periodic
dispatch = Dispatch(List=flatten_2, DispatchPattern=cls.Closed)  # -> ListA, ListB
graft = GraftTree(Tree=dispatch.ListB, IncludeEmptyLists=True, IncludeNullItems=True)  # -> simplify(Tree)
end = EndPoints(Curve=graft)  # -> Start, End
ln = Line(StartPoint=end.Start, EndPoint=end.End)
merge = Merge(Data1=graft, Data2=ln)
join = JoinCurves(Curves=merge, Preserve=False)
merge_2 = Merge(Data1=dispatch.ListA, Data2=join)  # -> flatten(Result)
graft_2 = GraftTree(Tree=merge_2, IncludeEmptyLists=True, IncludeNullItems=True)  # -> simplify(Tree)
bbox_2 = BoundingBox(Content=graft_2, Plane=PlaneXY(0, 0, 0))  # -> Box, Box_2
dom = ConstructDomain(DomainStart=Slider(0.5, range=0..1), DomainEnd=Slider(0.95, range=0..1))
area_2 = Area(Geometry=bbox_2.Box)  # -> Area, Centroid
bnd = Bounds(Numbers=flatten(area_2.Area))
remap = RemapNumbers(Value=area_2.Area, Source=bnd, Target=dom)  # -> Mapped, Clipped
scale_2 = Scale(Geometry=graft_2, Center=area_2.Centroid, Factor=remap.Mapped)  # -> simplify(Geometry), Transform
merge_3 = Merge(Data1=graft_2, Data2=scale_2.Geometry)
loft = Loft(Curves=merge_3, Options={Adjust=False, Closed=False, LoftEnds=0, LoftSimp=0, LoftType=0, Rebuild=10, Refit=0.01})  # -> flatten(Loft)
join_2 = BrepJoin(Breps=loft)  # -> Breps, Closed
smesh = SimpleMesh(Brep=join_2.Breps)
wbthicken = WeaverbirdsMeshThicken(MeshCurves=smesh, Distance=Slider(25, range=0..100), OffsetType=0)
wbcatmullclark = WeaverbirdsCatmullClarkSubdivision(MeshCurves=wbthicken, Level=Slider(2, range=0..10), SmoothNakedEdges=1)
demesh = DeconstructMesh(Mesh=wbcatmullclark)  # -> Vertices, Faces, Colours, Normals
Z = UnitZ(Factor=1)
preview_2 = CustomPreview(Geometry=wbcatmullclark, Material=ColourSwatch(SwatchColor=RGB(79, 220, 255)))
dprod = DotProduct(VectorA=demesh.Normals, VectorB=Z, Unitize=False)
bnd_2 = Bounds(Numbers=dprod)
remap_2 = RemapNumbers(Value=dprod, Source=bnd_2, Target=Domain(0, 1))  # -> Mapped, Clipped
gradient = Gradient(
    LowerLimit=0,
    UpperLimit=1,
    Parameter=remap_2.Mapped,
    stops=[0.0877: RGB(0, 64, 255), 0.721: RGB(220, 0, 40), 1: RGB(255, 255, 255)])
mcol = MeshColours(Mesh=wbcatmullclark, Colours=gradient)
