# Grasshopper definition CustomPopulateGeometry3.gh (Grasshopper 1.0.7)
# plug-ins: Weaverbird

number_slider = Slider(1000, range=0..1000)
planesrf = PlaneSurface(Plane=PlaneXY(0, 0, 0), XSize=number_slider, YSize=number_slider)
popgeo = PopulateGeometry(Geometry=planesrf, Count=Slider(3, range=0..10), Seed=1)
merge = Merge(Data1=Slider(536, range=0..2000), Data2=Slider(610, range=0..2000), Data3=Slider(1228, range=0..2000))
merge_2 = Merge(Data1=Slider(-0.39, range=-1..1), Data2=Slider(-0.56, range=-1..1), Data3=Slider(0.39, range=-1..1))
sph = Sphere(Base=popgeo, Radius=Slider(12, range=0..40))
c_script = CSharpScript(
    brep=planesrf,
    attractors=popgeo,
    num=Slider(1000, range=0..1000),
    ite=Slider(100, range=10..100),
    attractor_rads=merge,
    attractor_pows=merge_2)  # -> out, A; inputs brep: Brep, attractors: list of Point3d, num: Int32, ite: Int32, attractor_rads: list of Double, attractor_pows: list of Double
# ---------- c_script: C# usings ----------
using Rhino.Collections;
# ---------- c_script: C# ----------
    var points = new Point3dList();

    if(brep != null){
      var attracts = new Point3dList(attractors);
      var rnd = new Random();
      var bbox = brep.GetBoundingBox(true);

      for(int i = 0; i < num; i++){

        if(points.Count == 0){
          var rndpt = CreateRandomPoint(rnd, brep, bbox);
          points.Add(rndpt);
        }else{

          double fdist = -1;
          Point3d fpos = new Point3d();
          for(int t = 0; t < Math.Max(Math.Min(ite, i), 10); t++){
            var nrndpt = CreateRandomPoint(rnd, brep, bbox);

            double nattractdist = 1;
            for(int n = 0; n < attracts.Count; n++){
              var nattract = attracts[n];
              var rad = attractor_rads[Math.Min(n, attractor_rads.Count - 1)];
              var pow = attractor_pows[Math.Min(n, attractor_pows.Count - 1)];

              var ntdist = Math.Pow(Remap(Math.Min(nattract.DistanceTo(nrndpt), rad), 0, rad, 0, 1.0), pow);
              nattractdist *= ntdist;
            }

            var nindex = points.ClosestIndex(nrndpt);
            var npos = points[nindex];

            var ndist = npos.DistanceTo(nrndpt) * nattractdist;

            if(fdist < ndist){
              fdist = ndist;
              fpos = nrndpt;
            }
          }
          points.Add(fpos);
        }
      }
    }

    A = points;
# ---------- c_script: C# additional code ----------
  double Remap(double val, double smin, double smax, double tmin, double tmax){
    return (val - smin) / (smax - smin) * (tmax - tmin) + tmin;
  }

  Point3d CreateRandomPoint(Random rnd, Brep brep, BoundingBox bbox){
    var x = Remap(rnd.NextDouble(), 0.0, 1.0, bbox.Min.X, bbox.Max.X);
    var y = Remap(rnd.NextDouble(), 0.0, 1.0, bbox.Min.Y, bbox.Max.Y);
    var z = Remap(rnd.NextDouble(), 0.0, 1.0, bbox.Min.Z, bbox.Max.Z);

    return brep.ClosestPoint(new Point3d(x, y, z));
  }
# ---------- end c_script ----------
preview = CustomPreview(Geometry=sph, Material=ColourSwatch(SwatchColor=RGB(255, 212, 0)))
voronoi = Voronoi(Points=c_script.A, Boundary=planesrf, BruteForceOverride=False)
preview_2 = CustomPreview(Geometry=c_script.A, Material=ColourSwatch(SwatchColor=RGB(0, 162, 255)))
area = Area(Geometry=voronoi)  # -> Area, Centroid
pow = Power(A=area.Area, B=Slider(0.6, range=0..1))
mesh = Mesh(voronoi)
bnd = Bounds(Numbers=pow)
graft = GraftTree(Tree=mesh, IncludeEmptyLists=True, IncludeNullItems=True)
graft_2 = GraftTree(Tree=pow, IncludeEmptyLists=True, IncludeNullItems=True)
remap = RemapNumbers(Value=pow, Source=bnd, Target=Domain(0, 1))  # -> Mapped, Clipped
wbthicken = WeaverbirdsMeshThicken(MeshCurves=graft, Distance=graft_2, OffsetType=0)
unweld = UnweldMesh(Mesh=wbthicken, Angle=1.570796327)
gradient = Gradient(
    LowerLimit=0,
    UpperLimit=1,
    Parameter=remap.Mapped,
    stops=[0: RGB(64, 0, 12), 0.169: RGB(47, 132, 168), 0.366: RGB(130, 228, 255), 0.625: RGB(126, 171, 68), 1: RGB(255, 189, 36)])
graft_3 = GraftTree(Tree=gradient, IncludeEmptyLists=True, IncludeNullItems=True)
preview_3 = CustomPreview(Geometry=unweld, Material=graft_3)
